# Dynamo graph Dynamo_Wall_By_Room.dyn (Dynamo 2.13.1.3887)

code_block = CodeBlock { "Rooms"; }
byName = Category.ByName(name=code_block)
all_elements_of_category = ElementsOfCategory(Category=byName)
coreBoundary = Room.CoreBoundary(room=all_elements_of_category)
flatten = List.Flatten(list=coreBoundary)
watch = Watch(flatten)
python_script = Python(IN[0]=coreBoundary)  # CPython3
# ---------- python_script.python (24 lines) ----------
# Import required libraries
import clr
clr.AddReference('RevitAPI')
from Autodesk.Revit.DB import *

# Input port: Room.CoreBoundary output
coreBoundaries =IN[0]

# Initialize an empty list to store the processed data
processed_data = []


# Loop through each curve (line) in the core boundaries
for room in coreBoundaries:
    for boundaries in room:
        for line in boundaries:
            #line_data = line.AsCurve()
            #startpoint = line_data.GetEndPoint(0)
            #endpoint = line_data.GetEndPoint(1)
            #direction = line_date.Direction  # Computing direction

            #processed_data.append([startpoint, endpoint, direction])
            processed_data.append(line)
OUT = processed_data
# ----------------------------------------
code_block_2 = CodeBlock { "Walls"; }
byName_2 = Category.ByName(name=code_block_2)
all_elements_of_category_2 = ElementsOfCategory(Category=byName_2)
python_script_2 = Python(IN[0]=all_elements_of_category_2)  # CPython3
# ---------- python_script_2.python (32 lines) ----------
# Enable access to Revit API
import clr
clr.AddReference('RevitAPI')
from Autodesk.Revit.DB import *

# Import DocumentManager and TransactionManager
clr.AddReference("RevitServices")
import RevitServices
from RevitServices.Persistence import DocumentManager

# Access the current Revit document
doc = DocumentManager.Instance.CurrentDBDocument

# Input port: list of walls
walls = UnwrapElement(IN[0])  # Unwrap Dynamo elements to Revit elements

# Get the ground floor level
level_collector = FilteredElementCollector(doc).OfCategory(BuiltInCategory.OST_Levels).WhereElementIsNotElementType()
ground_level = [lvl for lvl in level_collector if lvl.Name == "groundfloor"]

# Initialize an empty list to store walls on the ground floor
walls_on_ground_floor = []

# Loop through each wall
for wall in walls:
    # Get the wall's associated level
    wall_level = doc.GetElement(wall.LevelId)
    if wall_level is not None and wall_level.Name == "groundfloor":
        walls_on_ground_floor.append(wall)

# Output the list of walls on the ground floor
OUT = walls_on_ground_floor
# ----------------------------------------
python_script_3 = Python(IN[0]=python_script_2)  # CPython3
# ---------- python_script_3.python (62 lines) ----------
import clr
clr.AddReference('RevitAPI')
from Autodesk.Revit.DB import *

# Import DocumentManager and TransactionManager
clr.AddReference("RevitServices")
import RevitServices
from RevitServices.Persistence import DocumentManager

from Autodesk.Revit.DB import XYZ

# Access the current Revit document
doc = DocumentManager.Instance.CurrentDBDocument

# Input port: list of walls
walls = UnwrapElement(IN[0])  # Unwrap Dynamo elements to Revit elements

# Initialize an empty list to store wall data
wall_data = []

def feet_to_mm(x_feet, y_feet, z_feet):
    # Conversion factor from feet to millimeters
    conversion_factor = 304.8
    # Apply the offset of -200 mm to X and Y values if positive, else +200 mm
    x_mm = x_feet * conversion_factor - 200 if x_feet >= 0 else x_feet * conversion_factor + 200
    y_mm = y_feet * conversion_factor - 200 if y_feet >= 0 else y_feet * conversion_factor + 200
    z_mm = z_feet * conversion_factor
    return (x_mm, y_mm, z_mm)
    
    
# Loop through each wall
for wall in walls:
    # Get the wall's location
    location = wall.Location
    
    if isinstance(location, LocationCurve):
        # For straight walls (LocationCurve type)
        curve = location.Curve
        # Get start point, end point, and direction
        start_point = curve.GetEndPoint(0)
        end_point = curve.GetEndPoint(1)
        direction = curve.Direction
        
         # Convert XYZ values from feet to millimeters
        start_point_mm = feet_to_mm(start_point.X, start_point.Y, start_point.Z)
        end_point_mm = feet_to_mm(end_point.X, end_point.Y, end_point.Z)
        
      
        SP = XYZ(start_point_mm[0],start_point_mm[1],start_point_mm[2])
        EP = XYZ(end_point_mm[0],end_point_mm[1],end_point_mm[2])
        line = Line.CreateBound(SP, EP)
        wall_data.append(line)
        # Append wall data to the list
        #wall_data.append([start_point_mm, end_point_mm, direction])
        

    else:
        # Handle other types of walls as needed
        wall_data.append(None)  # Append None for walls without a valid LocationCurve

# Output the list of wall data (start point, end point, direction)
OUT = wall_data
# ----------------------------------------
getActualLocation = AnalyticalAutomation.RevitElements.Element.GetActualLocation(element=python_script_2)
watch_2 = Watch(getActualLocation)
getLocation = Element.GetLocation(element=python_script_2)
watch_3 = Watch(getLocation)
python_script_4 = Python(IN[0]=python_script_2, IN[1]=all_elements_of_category)  # CPython3
# ---------- python_script_4.python (54 lines) ----------
# Enable access to Revit API
import clr
clr.AddReference('RevitAPI')
from Autodesk.Revit.DB import *

# Import DocumentManager and TransactionManager
clr.AddReference("RevitServices")
import RevitServices
from RevitServices.Persistence import DocumentManager

# Access the current Revit document
doc = DocumentManager.Instance.CurrentDBDocument

# Input port: list of walls
walls = UnwrapElement(IN[0])  # Unwrap Dynamo elements to Revit elements

# Input port: list of rooms
rooms = UnwrapElement(IN[1])  # Unwrap Dynamo elements to Revit elements

# Initialize an empty list to store nested walls data
nested_walls_list = []

# Loop through each room
for room in rooms:
    # Get the boundaries of the room
    boundaries = room.GetBoundarySegments(SpatialElementBoundaryOptions())
    
    # Initialize a sublist to store walls for each room
    room_walls = []
    
    if boundaries:
        # Collect curves representing the room's boundary
        room_curves = []
        for boundary in boundaries:
            for segment in boundary:
                curve = segment.GetCurve()
                room_curves.append(curve)
        
        # Loop through each wall
        for wall in walls:
            # Get the geometry of the wall
            wall_geometry = wall.Location.Curve
            
            # Check if wall's geometry intersects with the room boundary
            for room_curve in room_curves:
                if wall_geometry.Intersect(room_curve) != SetComparisonResult.Disjoint:
                    if wall not in room_walls:
                        room_walls.append(wall)
    
    # Append the sublist of walls for the room to the nested list
    nested_walls_list.append(room_walls)

# Output the nested list of walls bordering each room
OUT = nested_walls_list
# ----------------------------------------
python_script_5 = Python(IN[0]=python_script_2, IN[1]=all_elements_of_category)  # CPython3
# ---------- python_script_5.python (49 lines) ----------
# Enable access to Revit API
import clr
clr.AddReference('RevitAPI')
from Autodesk.Revit.DB import *

# Import DocumentManager and TransactionManager
clr.AddReference("RevitServices")
import RevitServices
from RevitServices.Persistence import DocumentManager

# Access the current Revit document
doc = DocumentManager.Instance.CurrentDBDocument

# Input port: list of walls
walls = UnwrapElement(IN[0])  # Unwrap Dynamo elements to Revit elements

# Input port: list of rooms
rooms = UnwrapElement(IN[1])  # Unwrap Dynamo elements to Revit elements

# Initialize an empty list to store nested walls data
nested_walls_list = []

# Loop through each room
for room in rooms:
    # Get the boundaries of the room
    boundaries = room.GetBoundarySegments(SpatialElementBoundaryOptions())
    
    # Initialize a sublist to store walls for each room
    room_walls = []
    
    if boundaries:
        # Collect curves representing the room's boundary
        room_curves = [seg.GetCurve() for boundary in boundaries for seg in boundary]
        
        # Loop through each wall
        for wall in walls:
            # Get the geometry of the wall
            wall_geometry = wall.Location.Curve
            
            # Check if any part of wall's geometry intersects with the room boundary
            intersects = any(wall_geometry.Intersect(curve) != SetComparisonResult.Disjoint for curve in room_curves)
            if intersects:
                room_walls.append(wall)
    
    # Append the sublist of walls for the room to the nested list
    nested_walls_list.append(room_walls)

# Output the nested list of walls bordering each room
OUT = nested_walls_list
# ----------------------------------------
