# Dynamo graph Dynamo_Wall_Fire_Rating_GL_List_v2.dyn (Dynamo 2.13.1.3887)

code_block = CodeBlock { "Walls"; }
byName = Category.ByName(name=code_block)
all_elements_of_category = ElementsOfCategory(Category=byName)
watch = Watch(all_elements_of_category)
file_path = Filename("Dynamo\Fire_Resistance_Rating.xlsx")
string = StringInput("FR_GL2")
number = DoubleInput(1)
python_script = Python(IN[0]=all_elements_of_category)  # CPython3
# ---------- python_script.python (32 lines) ----------
# Enable access to Revit API
import clr
clr.AddReference('RevitAPI')
from Autodesk.Revit.DB import *

# Import DocumentManager and TransactionManager
clr.AddReference("RevitServices")
import RevitServices
from RevitServices.Persistence import DocumentManager

# Access the current Revit document
doc = DocumentManager.Instance.CurrentDBDocument

# Input port: list of walls
walls = UnwrapElement(IN[0])  # Unwrap Dynamo elements to Revit elements

# Get the ground floor level
level_collector = FilteredElementCollector(doc).OfCategory(BuiltInCategory.OST_Levels).WhereElementIsNotElementType()
ground_level = [lvl for lvl in level_collector if lvl.Name == "groundfloor"]

# Initialize an empty list to store walls on the ground floor
walls_on_ground_floor = []

# Loop through each wall
for wall in walls:
    # Get the wall's associated level
    wall_level = doc.GetElement(wall.LevelId)
    if wall_level is not None and wall_level.Name == "groundfloor":
        walls_on_ground_floor.append(wall)

# Output the list of walls on the ground floor
OUT = walls_on_ground_floor
# ----------------------------------------
code_block_2 = CodeBlock { "Fire Resistance Rating"; "BoundaryOfSpace"; "WallClass"; "MyifcGUID"; }
getParameterValueByName = Element.GetParameterValueByName(element=python_script, parameterName=code_block_2.out0)
exportToExcel = Data.ExportToExcel(filePath=file_path, sheetName=string, startRow=number, startColumn=number, data=getParameterValueByName)
number_2 = DoubleInput(0)
getParameterValueByName_2 = Element.GetParameterValueByName(element=python_script, parameterName=code_block_2.out3)
exportToExcel_2 = Data.ExportToExcel(filePath=file_path, sheetName=string, startRow=number, startColumn=number_2, data=getParameterValueByName_2)
uniqueId = Element.UniqueId(element=python_script)
number_3 = DoubleInput(2)
getParameterValueByName_3 = Element.GetParameterValueByName(element=python_script, parameterName=code_block_2.out1)
exportToExcel_3 = Data.ExportToExcel(filePath=file_path, sheetName=string, startRow=number, startColumn=number_3, data=getParameterValueByName_3)
number_4 = DoubleInput(3)
getParameterValueByName_4 = Element.GetParameterValueByName(element=python_script, parameterName=code_block_2.out2)
exportToExcel_4 = Data.ExportToExcel(filePath=file_path, sheetName=string, startRow=number, startColumn=number_4, data=getParameterValueByName_4)
watch_2 = Watch(python_script)
watch_3 = Watch(getParameterValueByName_2)
